% Simulink data dictionary FOV_SVPWM_Algorithm.sldd

I_s_max = Simulink.Parameter(350, DataType="single", Unit="A")  % Maximum stator current value in [A] dimension.
KI_c = Simulink.Parameter(30, DataType="single")  % Integral gain of the current controller.
Kp_c = Simulink.Parameter(1.1, DataType="single")  % Proportional gain of the current controller.

L_d = Simulink.Parameter(0.0003, DataType="single")  % Direct inductance of the PMSM machine in [H] dimension.
  % In theory, a typical PMSM motor used in 400V electric cars has ~0.3mH inductance value.

L_q = Simulink.Parameter(0.0003)  % Quadrature inductance of the PMSM machine in [H] dimension.
  % In theory, a typical PMSM motor used in 400V electric cars has ~0.3mH inductance value.

Psi_p = Simulink.Parameter(0.095, DataType="single", Unit="Wb")  % Pole flux value of the PMSM machine in [Wb] dimension.
  % In theory, a typical PMSM motor used in 400V electric cars has ~0.1Wb pole-flux value.

dq_decouping_ena = Simulink.Parameter(1, DataType="boolean")  % This variable enables or disables the voltage decoupling logic in the FOC algorithm. Voltage decoupling boosts the performance of the current controller by feedforward technique. However, in some cases it could force the current controller to be unstable. During the wake-up of the MIL simulation, it is wise to disable it.
dq_voltage_ratio = Simulink.Parameter(0.5773503, DataType="single")  % This variable gives the maximum synthesizable voltage or even current value in unary system. The maximum synthesizable dq voltage is 1/sqrt(3) of the measured battery voltage.

duty_sat_lower = Simulink.Parameter(0, Unit="%")  % This variable is needed for limiting the maximum duty output in [%] dimension towards the plant model.
  % In practice, MOSFETs and IGBTs have finite turn on-off time values, hence 0% and 100% duty can not be realised.

duty_sat_upper = Simulink.Parameter(100, DataType="single", Unit="%")  % This variable is needed for limiting the maximum duty output in [%] dimension towards the plant model.
  % In practice, MOSFETs and IGBTs have finite turn on-off time values, hence 0% and 100% duty can not be realised.

p = Simulink.Parameter(3, DataType="single")  % Number of pole-pairs of the PMSM machine.
svpwm_ena = Simulink.Parameter(1, DataType="boolean")  % This variable enables or disables the svpwm algorithm.